# Grasshopper definition 伸缩外壳2.gh (Grasshopper 1.0.7)
# plug-ins: Kangaroo2 Components

curve = Curve(<curve referenced from the Rhino model>)
curve_2 = Curve([<curve referenced from the Rhino model> x46])
curve_3 = Curve([<curve referenced from the Rhino model> x2])
curve_4 = Curve(<curve referenced from the Rhino model>)
curve_5 = Curve(<curve referenced from the Rhino model>)
curve_6 = Curve(<curve referenced from the Rhino model>)
curve_7 = Curve([<curve referenced from the Rhino model> x48])
number_slider = Slider(24, range=0..100)

curve_8 = Curve([<curve referenced from the Rhino model> x2])
curve_9 = Curve(<curve referenced from the Rhino model>)

curve_10 = Curve(<curve referenced from the Rhino model>)

# ---- group: 中轴长度
number_slider_2 = Slider(6, range=0..100)
length_line = LengthLine(Line=curve_6, Length=number_slider_2, Strength="1000")

# ----
number_slider_3 = Slider(71, range=0..100)

# ---- group: 曲柄长度
length_line_2 = LengthLine(Line=[curve_8, curve_9], Length=Slider(31, range=0..100), Strength="1000")

# ----
division = Division(A=number_slider_2, B="2")
length_line_3 = LengthLine(Line=curve_10, Length=division, Strength="1000")

end_points = EndPoints(Curve=curve_7)  # -> Start, End
end_points_2 = EndPoints(Curve=curve_10)  # -> Start, End
onplane = OnPlane(Plane=PlaneXY(0, 0, 0), Strength=1)
division_2 = Division(A=number_slider, B="2")
end_points_3 = EndPoints(Curve=curve_5)  # -> Start, End
onplane_2 = OnPlane(Plane=PlaneXY(0, 0, 0), Strength=1)
length = Length(Curve=curve_6)
explode = Explode(Curve=[curve_7, curve_8, curve_9], Recursive=True)  # -> Segments, Vertices
point = Point(<point referenced from the Rhino model>)
length_line_4 = LengthLine(Line=curve, Length=" 75.8", Strength="1000")
length_line_5 = LengthLine(Line=curve_3, Length=Slider(38, range=0..100), Strength="1000")
length_line_6 = LengthLine(Line=curve_4, Length=number_slider, Strength="1000")
length_2 = Length(Curve=curve_4)
length_line_7 = LengthLine(Line=curve_5, Length=division_2, Strength="1000")
explode_2 = Explode(Curve=[curve_2, curve_3, curve], Recursive=True)  # -> Segments, Vertices
point_2 = Point(<point referenced from the Rhino model>)
curve_middle = CurveMiddle(Curve=curve_4)

end_points_4 = EndPoints(Curve=curve_2)  # -> Start, End
unit_y = UnitY(Factor=Slider(37, range=0..100))
list_item = ListItem(List=end_points_4.Start, Index=Slider(20, range=0..100), Wrap=True)
list_item_2 = ListItem(List=end_points_4.End, Index=Slider(40, range=0..100), Wrap=True)
list_item_3 = ListItem(List=end_points_4.End, Index=Slider(4, range=0..100), Wrap=True)
list_item_4 = ListItem(List=end_points_4.End, Index=Slider(7, range=0..100), Wrap=True)
list_item_5 = ListItem(List=end_points_4.End, Index=Slider(43, range=0..100), Wrap=True)
list_item_6 = ListItem(List=end_points_4.End, Index=Slider(28, range=0..100), Wrap=True)  # disabled
number_slider_4 = Slider(35, range=0..100)
move = Move(Geometry=list_item_6, Motion=unit_y)  # -> Geometry, Transform
rigidbody = RigidBody(Part=curve_2, Points=point_2, Strength=10)  # -> RigidBody, Planes
relay = Relay([list_item, list_item_6])
unit_x = UnitX(Factor=number_slider_4)
unit_x_2 = UnitX(Factor=expr("-x", number_slider_4))
relay_2 = Relay([list_item_5, list_item_3, list_item_4, list_item_2])
move_2 = Move(Geometry=list_item_5, Motion=unit_x)  # -> Geometry, Transform
move_3 = Move(Geometry=list_item_3, Motion=unit_x_2)  # -> Geometry, Transform
line = Line(StartPoint=relay, EndPoint=curve_middle)
line_2 = Line(StartPoint=move_2.Geometry, EndPoint=move_3.Geometry)
oncurve = OnCurve(Points=relay_2, Curve=line_2, Strength="5000")
oncurve_2 = OnCurve(Points=relay, Curve=line, Strength="5000")

end_points_5 = EndPoints(Curve=[curve_7, curve_8, curve_9])  # -> Start, End
division_3 = Division(A=length, B="2")
unit_y_2 = UnitY(Factor=Slider(37, range=0..100))
curve_middle_2 = CurveMiddle(Curve=curve_6)
list_item_7 = ListItem(List=end_points.End, Index=Slider(28, range=0..100), Wrap=True)
list_item_8 = ListItem(List=end_points.Start, Index=Slider(20, range=0..100), Wrap=True)
list_item_9 = ListItem(List=end_points.Start, Index=Slider(44, range=0..100), Wrap=True)
list_item_10 = ListItem(List=end_points.End, Index=Slider(4, range=0..100), Wrap=True)
list_item_11 = ListItem(List=end_points.End, Index=Slider(3, range=0..100), Wrap=True)
end_points_6 = EndPoints(Curve=[curve_2, curve_3, curve])  # -> Start, End
list_item_12 = ListItem(List=end_points.Start, Index=Slider(40, range=0..100), Wrap=True)
length_3 = Length(Curve=explode.Segments)
division_4 = Division(A=length_2, B="2")
number_slider_5 = Slider(35, range=0..100)
end_points_7 = EndPoints(Curve=[curve_3, curve_5])  # -> Start, End
length_4 = Length(Curve=explode_2.Segments)
unit_x_3 = UnitX(Factor=division_3)
xy_plane = XYPlane(Origin=Point(0, 0, 0))
division_5 = Division(A=length, B="2")
move_4 = Move(Geometry=list_item_7, Motion=unit_y_2)  # -> Geometry, Transform
unit_x_4 = UnitX(Factor=division_4)
end_points_8 = EndPoints(Curve=[curve_8, curve_10])  # -> Start, End
anchor = Anchor(Point=end_points_2.End, Target=curve_middle_2, Strength="20000")
xy_plane_2 = XYPlane(Origin=Point(0, 0, 0))
division_6 = Division(A=length_2, B="2")
rigidbody_2 = RigidBody(Part=curve_7, Points=point, Strength=10)  # -> RigidBody, Planes
number_slider_6 = Slider(-180, range=-180..180)
line_3 = Line(StartPoint=move_4.Geometry, EndPoint=curve_middle_2)
relay_3 = Relay([list_item_8, list_item_7])
unit_x_5 = UnitX(Factor=expr("-x", number_slider_5))
anchor_2 = Anchor(Point=[end_points_3.End, curve_middle], Target=curve_middle, Strength="20000")
onplane_3 = OnPlane(Points=[end_points_5.End, end_points_5.Start, point], Plane=xy_plane, Strength="10000")
number_slider_7 = Slider(93, range=-180..180)
unit_x_6 = UnitX(Factor=number_slider_5)
unit_y_3 = UnitY(Factor=division_5)
relay_4 = Relay([list_item_12, list_item_10, list_item_11, list_item_9])
xy_plane_3 = XYPlane(Origin=Point(0, 0, 0))
onplane_4 = OnPlane(Points=[end_points_6.End, end_points_6.Start, point_2], Plane=xy_plane_2, Strength="10000")
unit_y_4 = UnitY(Factor=division_6)
length_line_8 = LengthLine(Line=explode.Segments, Length=length_3, Strength="500")
xy_plane_4 = XYPlane(Origin=Point(0, 0, 0))
length_line_9 = LengthLine(Line=explode_2.Segments, Length=length_4, Strength="500")
move_5 = Move(Geometry=list_item_12, Motion=unit_x_6)  # -> Geometry, Transform
move_6 = Move(Geometry=list_item_10, Motion=unit_x_5)  # -> Geometry, Transform
oncurve_3 = OnCurve(Points=relay_3, Curve=line_3, Strength="5000")

list_item_13 = ListItem(List=end_points_8.Start, Index="1", Wrap=True)
list_item_14 = ListItem(List=end_points_8.Start, Index="2", Wrap=True)
list_item_15 = ListItem(List=end_points_8.Start, Index=0, Wrap=True)

rotate = Rotate(Geometry=unit_x_3, Angle=degrees(number_slider_6), Plane=xy_plane_3)  # -> Geometry, Transform
rotate_2 = Rotate(Geometry=unit_y_3, Angle=degrees(number_slider_6), Plane=xy_plane_3)  # -> Geometry, Transform

list_item_16 = ListItem(List=end_points_7.End, Index="1", Wrap=True)
list_item_17 = ListItem(List=end_points_7.Start, Index="2", Wrap=True)
list_item_18 = ListItem(List=end_points_7.End, Index=0, Wrap=True)

rotate_3 = Rotate(Geometry=unit_x_4, Angle=degrees(number_slider_7), Plane=xy_plane_4)  # -> Geometry, Transform
rotate_4 = Rotate(Geometry=unit_y_4, Angle=degrees(number_slider_7), Plane=xy_plane_4)  # -> Geometry, Transform
line_4 = Line(StartPoint=move_5.Geometry, EndPoint=move_6.Geometry)
negative = Negative(Value=rotate.Geometry)
move_7 = Move(Geometry=curve_middle_2, Motion=rotate.Geometry)  # -> Geometry, Transform
negative_2 = Negative(Value=rotate_2.Geometry)
negative_3 = Negative(Value=rotate_3.Geometry)
move_8 = Move(Geometry=curve_middle, Motion=rotate_3.Geometry)  # -> Geometry, Transform
negative_4 = Negative(Value=rotate_4.Geometry)
move_9 = Move(Geometry=curve_middle_2, Motion=negative)  # -> Geometry, Transform
move_10 = Move(Geometry=curve_middle_2, Motion=negative_2)  # -> Geometry, Transform
oncurve_4 = OnCurve(Points=relay_4, Curve=line_4, Strength="5000")
move_11 = Move(Geometry=curve_middle, Motion=negative_3)  # -> Geometry, Transform
move_12 = Move(Geometry=curve_middle, Motion=negative_4)  # -> Geometry, Transform
anchor_3 = Anchor(Point=list_item_15, Target=move_7.Geometry, Strength="10000")
anchor_4 = Anchor(Point=list_item_13, Target=move_9.Geometry, Strength="10000")
anchor_5 = Anchor(Point=list_item_14, Target=move_10.Geometry, Strength="10000")
anchor_6 = Anchor(Point=list_item_16, Target=move_11.Geometry, Strength="10000")
anchor_7 = Anchor(Point=list_item_17, Target=move_12.Geometry, Strength="10000")
anchor_8 = Anchor(Point=list_item_18, Target=move_8.Geometry, Strength="10000")
merge = Merge(
    Data1=length_line_8,
    Data2=rigidbody_2.RigidBody,
    Data3=onplane_3,
    Data4=length_line_2,
    Data5=oncurve_3,
    Data6=anchor_3,
    Data7=anchor_4,
    Data8=oncurve_4,
    Data9=length_line,
    Data10=length_line_3,
    Data11=anchor_5,
    Data12=anchor)
merge_2 = Merge(
    Data1=length_line_9,
    Data2=rigidbody.RigidBody,
    Data3=onplane_4,
    Data4=length_line_5,
    Data5=oncurve_2,
    Data6=anchor_8,
    Data7=anchor_6,
    Data8=oncurve,
    Data9=length_line_6,
    Data10=length_line_7,
    Data11=anchor_7,
    Data12=anchor_2,
    Data13=length_line_4)
grab = Grab(On=True, Strength=1, Range=3)
grab_2 = Grab(On=True, Strength=1, Range=3)
bouncysolver = BouncySolver(
    GoalObjects=[merge, grab],
    Reset=Button(),
    Threshold=1e-15,
    Tolerance=0.0001,
    Damping=0.99,
    Iterations=10,
    On=Toggle(True))  # -> I, V, O
bouncysolver_2 = BouncySolver(
    GoalObjects=[merge_2, grab_2],
    Reset=Button(),
    Threshold=1e-15,
    Tolerance=0.0001,
    Damping=0.99,
    Iterations=10,
    On=Toggle(True))  # -> I, V, O
curve_11 = Curve(bouncysolver.O)
curve_12 = Curve(bouncysolver_2.O)
